# Grasshopper definition ABB_GoFa_robot_control_playground.gh (Grasshopper 1.0.7)
# plug-ins: Moonlight

# ----
# Robot model
connect = BooleanToggle(False)
ros = ROSConnect(connect=connect)  # -> ros_client, is_connected; inputs port: Int32, connect: Boolean
#   port ip: The ip address ROS. Defaults to 127.0.0.1.
#   port port: The port of ROS. Defaults to 9090.
#   port connect: If True, connects to ROS. If False, disconnects from ROS. Defaults to False.
#   port ros_client: The ROS client.
#   port is_connected: True if connection established.
# ---------- ros: Python ----------
"""
Connect or disconnect to ROS.

COMPAS FAB v0.27.0
"""
from ghpythonlib.componentbase import executingcomponent as component
from scriptcontext import sticky as st

from compas_fab.backends import RosClient
from compas_fab.ghpython.components import create_id


class ROSConnect(component):
    def RunScript(self, ip, port, connect):
        ros_client = None

        ip = ip or '127.0.0.1'
        port = port or 9090

        key = create_id(self, 'ros_client')
        ros_client = st.get(key, None)

        if ros_client:
            st[key].close()
        if connect:
            st[key] = RosClient(ip, port)
            st[key].run(5)

        ros_client = st.get(key, None)
        is_connected = ros_client.is_connected if ros_client else False
        return (ros_client, is_connected)
# ---------- end ros ----------
load_robot = BooleanToggle(False)
robot = ROSRobot(ros_client=ros.ros_client, load=load_robot)  # -> robot; inputs load: Boolean
#   port ros_client: The ROS client.
#   port load: If True, loads the robot from ROS. Defaults to False.
# ---------- robot: Python ----------
"""
Load robot directly from ROS.

COMPAS FAB v0.27.0
"""
from compas_ghpython.artists import RobotModelArtist
from ghpythonlib.componentbase import executingcomponent as component
from scriptcontext import sticky as st

from compas_fab.ghpython.components import create_id


class ROSRobot(component):
    def RunScript(self, ros_client, load):
        key = create_id(self, 'robot')

        if ros_client and ros_client.is_connected and load:
            # Load URDF from ROS
            st[key] = ros_client.load_robot(load_geometry=True, precision='12f')
            st[key].artist = RobotModelArtist(st[key].model)

        robot = st.get(key, None)
        if robot:  # client sometimes need to be restarted, without needing to reload geometry
            robot.client = ros_client
        return robot
# ---------- end robot ----------

# ----
# Table
swatch = ColourSwatch(SwatchColor=RGB(255, 254, 254))
material = CreateMaterial(Diffuse=swatch, Specular=RGB(255, 254, 254), Emission=RGB(0, 0, 0), Transparency=0, Shine=0)
brep = Brep(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)
preview = CustomPreview(Geometry=brep, Material=material)

reload = Button()
info = Info()  # -> info
#   port info: Environment info.
# ---------- info: Python ----------
"""
Displays information about the active COMPAS environment.
"""
import compas_bootstrapper
from ghpythonlib.componentbase import executingcomponent as component

import compas
import compas_fab


class CompasInfo(component):
    def RunScript(self):
        info = "Environment: {}\nCOMPAS Version: {}\nCOMPAS_FAB Version: {}"
        return info.format(compas_bootstrapper.ENVIRONMENT_NAME, compas.__version__, compas_fab.__version__)
# ---------- end info ----------

# ----
# Element
# Predefine a brick element and its dimensions
# Visualise the defined element
show = BooleanToggle(False)
elem_def = GhPythonScript()  # -> out, elem_full
# ---------- elem_def: Python ----------
import os
import sys
import json

from compas.geometry import Frame

from assembly_information_model.assembly import Element

# dimensions full brick
width = 0.05
length = 0.1
height = 0.0265

elem_full = Element.from_dimensions(length, width, height)
elem_full.tool_frame = Frame([0, 0, height*2/3],  [1, 0, 0], [0, -1, 0])
# ---------- end elem_def ----------
draw = PythonScript(elem_full=elem_def.elem_full, show=show)  # -> M, F, S
# ---------- draw: Python ----------
from compas.geometry import Transformation
from compas.geometry import Frame
from compas.datastructures import mesh_transformed
from compas_ghpython.artists import MeshArtist
from compas_ghpython import draw_frame

if show:
    artist = MeshArtist(elem_full.mesh)
    M = [artist.draw()]
    F = [draw_frame(elem_full.frame)]
    #S = [draw_frame(elem_full._source.frame)]
    S = [draw_frame(elem_full.tool_frame)]
    
    
    #artist = MeshArtist(elem_half.mesh)
    #M += [artist.draw()]
    #F += [draw_frame(elem_half.frame)]
    #S += [draw_frame(elem_half._source.frame)]
    #S = [draw_frame(elem_half.tool_frame)]
# ---------- end draw ----------

# ----
# Tool
gripper_meshes = Mesh([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])
gripper_tcf = Plane(Plane(origin=(0, 0, 0.1534), x=(-0.7071067812, 0.7071067812, 0), y=(-0.7071067812, -0.7071067812, 0)))
gripper_bounding_box_mesh = Mesh(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)
mjoin = MeshJoin(Meshes=gripper_meshes)
tool = AttachedTool(robot=robot, visual_mesh=mjoin, collision_mesh=gripper_bounding_box_mesh, tcf_plane=gripper_tcf)  # -> robot; inputs visual_mesh: Mesh, collision_mesh: Mesh
#   port visual_mesh: A visual mesh for the tool.
#   port collision_mesh: A collision mesh for the tool.
#   port tcf_plane: The frame of the tool in tool0 frame.
#   port group: The planning group to which the tool should be attached.
# ---------- tool: Python ----------
"""
Attach a tool to the robot.

COMPAS FAB v0.27.0
"""
from ghpythonlib.componentbase import executingcomponent as component
from compas_rhino.conversions import RhinoMesh
from compas_rhino.conversions import plane_to_compas_frame

from compas.geometry import Frame
from compas_fab.robots import Tool


class AttachToolComponent(component):
    def RunScript(self, robot, visual_mesh, collision_mesh, tcf_plane, group):
        if robot and robot.client and robot.client.is_connected and visual_mesh:
            if not collision_mesh:
                collision_mesh = visual_mesh

            c_visual_mesh = RhinoMesh.from_geometry(visual_mesh).to_compas()
            c_collision_mesh = RhinoMesh.from_geometry(collision_mesh).to_compas()

            if not tcf_plane:
                frame = Frame.worldXY()
            else:
                frame = plane_to_compas_frame(tcf_plane)
                print frame.quaternion
            tool = Tool(c_visual_mesh, frame, c_collision_mesh)

            robot.attach_tool(tool, group)

        return robot
# ---------- end tool ----------

panel = Panel(info)
moonlight = Moonlight(Mode=Toggle(True))
python_script = PythonScript(reload=reload)  # -> out; inputs reload: Boolean
# ---------- python_script: Python ----------
#import os
#import sys
from compas_rhino.utilities.misc import get_tolerance
from compas_rhino.utilities.misc import unload_modules

if reload:
    #print "reloading..."
    unload_modules("compas")
    unload_modules("compas_fab")
    unload_modules("roslibpy")



import compas
import compas_fab
import compas_bootstrapper
print "environment =", compas_bootstrapper.ENVIRONMENT_NAME
print "compas =", compas.__version__
print "compas_fab =", compas_fab.__version__
#print compas_fab.__file__
# ---------- end python_script ----------
panel_2 = Panel(python_script)
panel_3 = Panel(ros.is_connected)
pt = Point(Point(0.6013599796, 0.01724124192, 0.2615639184))

# ---- group: forward kinematics
# Forward Kinematics
load_presets = Button()
jp = GhPythonScript()  # -> all_joint_value_zero
# ---------- jp: Python ----------
import math
all_joint_value_zero = [0] * 6
print all_joint_value_zero
# ---------- end jp ----------
a1 = Slider(-22, range=-180..180)
a2 = Slider(0, range=-360..360)
a3 = Slider(0, range=-360..360)
a5 = Slider(0, range=-360..360)
a6 = Slider(0, range=-360..360)
a4 = Slider(0, range=-360..360)
forward_kinematics = PythonScript(robot=tool, set_joint_positions=load_presets, joint_positions=jp, a1=a1, a2=a2, a3=a3, a4=a4, a5=a5, a6=a6)  # -> full_configuration; inputs joint_positions: list
# ---------- forward_kinematics: Python ----------
import math
import Grasshopper
from compas.robots import Joint
from compas_fab.robots import Configuration

if set_joint_positions:

    j = 0
    for i in range(ghenv.Component.Params.Input.Count):
        nslider = ghenv.Component.Params.Input[i].Sources[0]
        if nslider.GetType() == Grasshopper.Kernel.Special.GH_NumberSlider:
            nslider.TrySetSliderValue(joint_positions[j])
            j += 1

if robot:
    joint_positions = [a1, a2, a3, a4, a5, a6]
    joint_types = robot.get_configurable_joint_types()
    for i, joint_type in enumerate(joint_types):
        if joint_type == Joint.REVOLUTE:
            joint_positions[i] = math.radians(joint_positions[i])
    full_configuration = Configuration(joint_positions, joint_types)
# ---------- end forward_kinematics ----------

# ----
jp_2 = GhPythonScript()  # -> packing_joint_values
# ---------- jp_2: Python ----------
import math
packing_joint_values = [0, 0, 85, 0, 0, 0]
print packing_joint_values
# ---------- end jp_2 ----------
jp_3 = GhPythonScript()  # -> home_vertical_joint_values
# ---------- jp_3: Python ----------
import math
home_vertical_joint_values = [0, 0, 0, 0, 90, -45]
print home_vertical_joint_values
# ---------- end jp_3 ----------

# ---- group: Simulation from MoveIt / target plane
pln = Plane(pt)

# ----
list = ValueList({"20", "50", "100", "500", "1000", "5000"}, selected="50")
back = Button()
reset = Button()
start = Button()
stop = Button()
step = Button()
full = Button()

pflip = FlipPlane(Plane=pln, ReverseX=False, ReverseY=False, SwapAxes=True)

# ---- group: Simulation from MoveIt
# Inverse Kinematics
zero_config = ZeroConfig(robot=tool)  # -> config
#   port group: If assigned, it will return the zero configuration for the given group, otherwise a full zero configuration.
#   port config: The zero configuration.
# ---------- zero_config: Python ----------
"""
Get a zero configuration for a robot.

COMPAS FAB v0.27.0
"""
from ghpythonlib.componentbase import executingcomponent as component


class ConfigZero(component):
    def RunScript(self, robot, group):

        if robot:
            return robot.zero_configuration(group)

        return None
# ---------- end zero_config ----------
ik = InverseKinematics(robot=tool, plane=pflip, start_configuration=zero_config)  # -> configuration
#   port plane: The plane or frame to calculate the inverse kinematic for.
#   port start_configuration: If passed, calculates the inverse such that the joint positions differ the least from the start_configuration. Defaults to the zero configuration.
#   port group: The planning group used for calculation. Defaults to the robot's main planning group.
#   port configuration: The planning group's configuration.
# ---------- ik: Python ----------
"""
Calculate the robot's inverse kinematic for a given plane.

COMPAS FAB v0.27.0
"""
from compas_rhino.conversions import RhinoPlane
from compas.geometry import Frame
from ghpythonlib.componentbase import executingcomponent as component


class InverseKinematics(component):
    def RunScript(self, robot, plane, start_configuration, group):
        configuration = None
        if robot and robot.client and robot.client.is_connected and plane:
            frame = RhinoPlane.from_geometry(plane).to_compas_frame()
            configuration = robot.inverse_kinematics(frame, start_configuration, group, options={
                                                    'avoid_collisions':False,
                                                    'return_full_configuration':True,
                                                  })     
        return configuration
# ---------- end ik ----------

# ----
show_end_effector_frame = BooleanToggle(True)
show_base_frame = BooleanToggle(False)
show_frames = BooleanToggle(False)

# ----
# Draw robot
list_2 = ValueList({"Forward Kinematics": 0, "Inverse Kinematics": 1}, selected="Inverse Kinematics")
entwine = Entwine(Branch00=forward_kinematics, Branch01=ik, FlattenInputs=True)  # -> simplify(Result)
path = ConstructPath(Indices=list_2)
branch = TreeBranch(Tree=entwine, Path=path, MaintainPaths=True)
robot_visualize = RobotVisualize(
    robot=tool,
    configuration=branch,
    show_frames=show_frames,
    show_base_frame=show_base_frame,
    show_end_effector_frame=show_end_effector_frame)  # -> visual, collision, collision_meshes, attached_meshes, frames, base_frame, ee_frame; inputs show_visual: Boolean, show_collision: Boolean, show_frames: Boolean, show_base_frame: Boolean, show_end_effector_frame: Boolean, show_cm: Boolean, show_acm: Boolean
#   port group: The planning group used for end-effector and base visualization.
#   port configuration: The robot's full configuration.
#   port show_visual: Whether or not to show the robot's visual meshes.
#   port show_collision: Whether or not to show the robot's collision meshes.
#   port show_frames: Whether or not to show the robot's joint frames.
#   port show_base_frame: Whether or not to show the robot's base frame.
#   port show_end_effector_frame: Whether or not to show the robot's end-effector frame.
#   port show_cm: Whether or not to show the collision meshes (if any).
#   port show_acm: Whether or not to show the attached collision meshes (if any).
#   port visual: Rhino meshes of the robot's visual geometry (if any).
#   port collision: Rhino meshes of the robot's collision geometry (if any).
#   port collision_meshes: Rhino meshes of the scene's collision meshes (if any).
#   port attached_meshes: Rhino meshes of the scene's attached collision meshes (if any).
#   port frames: The robot's joint frames as Rhino planes (if any).
#   port base_frame: The robot's base frame as a Rhino plane (if any).
#   port ee_frame: The robot's end-effector frame as a Rhino plane (if any).
# ---------- robot_visualize: Python ----------
"""
Visualizes the robot.

COMPAS FAB v0.27.0
"""
from compas.artists import Artist
from compas.geometry import Frame
from compas.geometry import Transformation
from compas_fab.robots import PlanningScene
from ghpythonlib.componentbase import executingcomponent as component


class RobotVisualize(component):
    def RunScript(
        self,
        robot,
        group,
        configuration,
        show_visual,
        show_collision,
        show_frames,
        show_base_frame,
        show_end_effector_frame,
        show_cm,
        show_acm,
    ):

        visual = None
        collision = None
        collision_meshes = None
        attached_meshes = None
        frames = None
        base_frame = None
        ee_frame = None

        if robot:
            show_visual = True if show_visual is None else show_visual
            show_cm = True if show_cm is None else show_cm
            show_acm = True if show_acm is None else show_acm
            configuration = configuration or robot.zero_configuration()

            robot.update(configuration, visual=show_visual, collision=show_collision)
            compas_frames = robot.transformed_frames(configuration, group)

            if show_visual:
                visual = robot.artist.draw_visual()

            if show_collision:
                collision = robot.artist.draw_collision()

            if show_base_frame:
                base_compas_frame = compas_frames[0]
                artist = Artist(base_compas_frame)
                base_frame = artist.draw()

            if show_end_effector_frame:
                ee_compas_frame = robot.forward_kinematics(
                    configuration, group, options=dict(solver="model")
                )
                artist = Artist(ee_compas_frame)
                ee_frame = artist.draw()

            if show_frames:
                frames = []
                for compas_frame in compas_frames[1:]:
                    artist = Artist(compas_frame)
                    frame = artist.draw()
                    frames.append(frame)

            if show_cm or show_acm:
                scene = PlanningScene(robot)
                scene = robot.client.get_planning_scene()

                collision_meshes = []
                attached_meshes = []

                if show_cm:
                    for co in scene.world.collision_objects:
                        header = co.header
                        frame_id = header.frame_id
                        cms = co.to_collision_meshes()

                        for cm in cms:
                            if cm.frame != Frame.worldXY():
                                t = Transformation.from_frame(cm.frame)
                                mesh = cm.mesh.transformed(t)
                            else:
                                mesh = cm.mesh

                            collision_meshes.append(Artist(mesh).draw())

                if show_acm:
                    for aco in scene.robot_state.attached_collision_objects:
                        for acm in aco.to_attached_collision_meshes():
                            frame_id = aco.object["header"]["frame_id"]
                            frame = robot.forward_kinematics(
                                configuration, options=dict(link=frame_id)
                            )
                            t = Transformation.from_frame(frame)

                            # Local CM frame
                            if (
                                acm.collision_mesh.frame
                                and acm.collision_mesh.frame != Frame.worldXY()
                            ):
                                t = t * Transformation.from_frame(
                                    acm.collision_mesh.frame
                                )

                            mesh = acm.collision_mesh.mesh.transformed(t)

                            attached_meshes.append(Artist(mesh).draw())

        return (
            visual,
            collision,
            collision_meshes,
            attached_meshes,
            frames,
            base_frame,
            ee_frame,
        )
# ---------- end robot_visualize ----------
draw_2 = GhPythonScript(frames=[robot_visualize.ee_frame, robot_visualize.frames, robot_visualize.base_frame], scale=Slider(0.1, range=0..1))  # -> P, V, C, W; inputs frames: list
# ---------- draw_2: Python ----------
from System.Drawing import Color
from compas_ghpython.artists import FrameArtist

red = Color.FromArgb(255, 0, 0)
green = Color.FromArgb(0, 255, 0)
blue = Color.FromArgb(0, 0, 255)

P = []
V = []
C = []

scale = float(scale)

for plane in frames:
    if not plane:
        continue
    P += [plane.Origin] * 3
    V.append(plane.XAxis * scale)
    V.append(plane.YAxis * scale)
    V.append(plane.ZAxis * scale)
    C += [red, green, blue]

W = 3
# ---------- end draw_2 ----------
vdisex = VectorDisplayEx(Point=draw_2.P, Vector=draw_2.V, Colour=draw_2.C, Width=draw_2.W)

# ----
# Robot
# control
number_slider = Slider(300, range=0..300)
ros_client = Data(ros.ros_client)

# ----
# Send text to flexpendant
panel_4 = Panel("Hello LE.AR.N!")
run = Button()
send_text = GhPythonScript(message=panel_4, ros=ros_client, run=run)
# ---------- send_text: Python ----------
import compas_rrc as rrc
abb = rrc.AbbClient(ros, '/rob1')
print('Connected.')

if run : 
    abb.send_and_wait(rrc.PrintText(message), timeout = 10)
# ---------- end send_text ----------

# ----
# Gripper on/off
open = Button()
close = Button()
gripper = GhPythonScript(ros=ros_client, open=open, close=close)  # inputs open: Boolean
# ---------- gripper: Python ----------
import compas_rrc as rrc
abb = rrc.AbbClient(ros, '/rob1')
print('Connected.')

if open : 
    abb.send(rrc.SetDigital('ABB_Scalable_IO_0_DO16', 1))
    
if close : 
    abb.send(rrc.SetDigital('ABB_Scalable_IO_0_DO16', 0))
# ---------- end gripper ----------

# ----
# Send joint values
run_2 = Button()
send_joints = GhPythonScript(configuration=branch, ros=ros_client, run=run_2, speed=number_slider)
# ---------- send_joints: Python ----------
import compas_rrc as rrc
import math
abb = rrc.AbbClient(ros, '/rob1')
print('Connected.')

#external_axes = [0,0,0,0,0,0]
external_axes = []

if run : 
    robot_joints = [math.degrees(jv) for jv in configuration.joint_values]
    print("robot_joints =", robot_joints)
    abb.send_and_wait(rrc.MoveToJoints(robot_joints, external_axes, speed, rrc.Zone.Z10), timeout = 10)
# ---------- end send_joints ----------

# ----
# Get frame and joint values
run_3 = Button()
get_frame_joints = GhPythonScript(ros=ros_client, run=run_3)  # -> frame, joints
# ---------- get_frame_joints: Python ----------
import compas_rrc as rrc
abb = rrc.AbbClient(ros, '/rob1')
print('Connected.')

if run: 
    # Set tool
    abb.send(rrc.SetTool('tool0'))
    
    # Set work object
    abb.send(rrc.SetWorkObject('wobj0'))
    
    # Read current frame position
    frame = abb.send_and_wait(rrc.GetFrame(), timeout = 10)
    print("frame: ", frame)
    
    # Read current Configuration
    joints = abb.send_and_wait(rrc.GetJoints(), timeout = 10)
    print("joints: ", joints)
# ---------- end get_frame_joints ----------
cluster = Cluster(rec=get_frame_joints.frame, rec_2=get_frame_joints.joints)  # -> plane, configuration_2
panel_5 = Panel(cluster.plane)
panel_6 = Panel(cluster.configuration_2)

list_3 = ValueList({"Send all elements": "all", "Send current element": "current"}, selected="Send current element")
table_mesh = Mesh(brep)

# ----
# Assembly
y_axis = Curve(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)
x_axis = Curve(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)
plane = PythonScript(plane_axes=[x_axis, y_axis])  # -> plane; inputs plane_axes: list of Curve
# ---------- plane: Python ----------
import Rhino.Geometry as rg

x_axis, y_axis = plane_axes

x_axis = rg.Line(x_axis.PointAtStart, x_axis.PointAtEnd)
y_axis = rg.Line(y_axis.PointAtStart, y_axis.PointAtEnd)

if x_axis.From.DistanceTo(y_axis.From) < 0.01:
    origin = x_axis.From
    xvec = x_axis.Direction
    yvec = y_axis.Direction
elif x_axis.To.DistanceTo(y_axis.To) < 0.01:
    origin = x_axis.To
    xvec = -x_axis.Direction
    yvec = -y_axis.Direction
elif x_axis.From.DistanceTo(y_axis.To) < 0.01:
    origin = x_axis.From
    xvec = x_axis.Direction
    yvec = -y_axis.Direction
elif x_axis.To.DistanceTo(y_axis.From) < 0.01:
    origin = x_axis.To
    xvec = -x_axis.Direction
    yvec = y_axis.Direction

plane = rg.Plane(origin, xvec, yvec)
# ---------- end plane ----------
cp_new = Plane(plane)

# ----
# Brick wall
pt_2 = Point([Point(0.9671119473, -0.03267675168, 0.0504260254), Point(-0.1029288014, 0.3971637288, -0.1479900893), Point(-0.5443898693, 0.6772395517, 0.8000593736)])

generate_assembly = GhPythonScript(elem_full=elem_def.elem_full, transform=Toggle(True), ptransf=cp_new, attr_pts=pt_2)  # -> assembly, COURSES; inputs ptransf: Plane, attr_pts: list of Point3d
# ---------- generate_assembly: Python ----------
import Rhino.Geometry as rg
import math
from scriptcontext import sticky as st


from compas.geometry import Frame
from compas.geometry import Transformation
from compas.geometry import Rotation
from compas.geometry import Translation
from compas.geometry import Point

from compas_ghpython import draw_frame

from assembly_information_model.assembly import Assembly

import Rhino.Geometry as rg



length, width, height = [elem_full._source.xsize, elem_full._source.ysize, elem_full._source.zsize]
#print(width, length, height)

COURSES = 7
bricks_in_course = 4

MORTAR_PERPENDS = 0.01

total_length = bricks_in_course * length + (bricks_in_course - 1) * MORTAR_PERPENDS
gap = MORTAR_PERPENDS

assembly = Assembly() # initialize an empty assembly class
planes = [] # just for vizualisation

for course in range(COURSES):
    dy = course * height
    is_odd = course % 2 != 0
    dx = 0
    for j in range(bricks_in_course):
        first = j == 0
        last = j == bricks_in_course - 1
        if is_odd:
            T = Translation.from_vector([dx + length/5 , 0, dy])
            e = elem_full.transformed(T)
            dx += length + gap/2
        else:
            T = Translation.from_vector([dx, 0, dy])
            e = elem_full.transformed(T)
            dx += length
        
        cpt = e.frame.point
        
        #apply rotation to the bricks according to the distance of the attractor points
        min_dist = 10
        for attr_pt in attr_pts:
            dist =  attr_pt.DistanceTo(rg.Point3d(cpt.x, cpt.y, cpt.z))
            if dist<min_dist:
                min_dist = dist
            #print dist
        dist = min_dist
        if is_odd:
            R = Rotation.from_axis_and_angle([0,0,1], -math.radians(1/(0.3*dist*dist)), point=e.frame.point) 
        else:
            R = Rotation.from_axis_and_angle([0,0,1], math.radians(1/(0.3*dist*dist)), point=e.frame.point) 
        e.transform(R)
        
        planes.append(draw_frame(e.tool_frame)) #only for visualizing in gh
        assembly.add_element(e, course=course)
        dx += gap

if transform:
    T = Transformation.from_frame_to_frame(Frame.worldXY(), Frame(ptransf.Origin, ptransf.XAxis, ptransf.YAxis))
    assembly.transform(T)
    assembly.network.transform(T)
# ---------- end generate_assembly ----------

add_edges = PythonScript(COURSES=generate_assembly.COURSES, assembly=generate_assembly.assembly)  # -> assembly; inputs COURSES: Int32
# ---------- add_edges: Python ----------
 
for course in range(COURSES):
    curr_course = [key for key in assembly.network.nodes_where({'course': course})]
    prev_course = [key for key in assembly.network.nodes_where({'course': course-1})]

    for k in range(len(curr_course)):
        if course != 0:
            assembly.add_connection(curr_course[k],prev_course[k])
            if k != len(curr_course)-1:
                assembly.add_connection(curr_course[k],prev_course[k+1])
# ---------- end add_edges ----------

# ----
# Draw assembly
show_2 = BooleanToggle(True)
show_3 = BooleanToggle(True)
show_4 = BooleanToggle(False)
show_5 = BooleanToggle(False)
show_6 = BooleanToggle(True)
panel_7 = Panel("Assembly Visualization")
counter = CountThroughList(
    assembly=generate_assembly.assembly,
    start=start,
    stop=stop,
    step=step,
    step_back=back,
    reset=reset,
    full=full,
    interval=list)  # -> item, counter; inputs start: Boolean, stop: Boolean, step_back: Boolean
# ---------- counter: Python ----------
from scriptcontext import sticky as st
from compas_ghpython import update_component


L = list(assembly.elements())
# store data in component
guid = str(ghenv.Component.InstanceGuid)
counter_key = "counter_" + guid
running_key = "running_" + guid

if counter_key not in st:
    st[counter_key] = 0

if running_key not in st:
    st[running_key] = False
    

if st[running_key]:
    if st[counter_key] < len(L) - 1:
        st[counter_key] += 1
        update_component(ghenv, interval)
    else:
        st[counter_key] = 0
        st[running_key] = False
    
    
if start:
    st[running_key] = True

if stop:
    st[running_key] = False

if step:
    if st[counter_key] < len(L) - 1:
        st[counter_key] += 1

if step_back:
    if st[counter_key] < len(L):
        st[counter_key] -= 1

if reset:
    st[counter_key] = 0

if full:
    st[counter_key] = len(L)-1

if len(L):
    item = L[st[counter_key]]



#st["visualisation_counter"] = st[counter_key]
#st[counter_key]= 50
counter = st[counter_key]
# ---------- end counter ----------
idx = Panel(counter.counter)
draw_3 = PythonScript(
    assembly=add_edges,
    current_key=idx,
    show_current_element=show_6,
    show_course=show_4,
    show_all=show_5,
    show_until_key=show_3,
    show_network=show_2)  # -> G_element, G_elements, G_course, current_tool_plane, current_path_planes, tool_planes_WCS, G_nodes, G_edges; inputs current_key: Int32
# ---------- draw_3: Python ----------
import os
import sys

import math

import Rhino.Geometry as rg

from compas_ghpython.artists import MeshArtist
from compas_ghpython.artists import NetworkArtist
from compas_ghpython import draw_frame


G_element = []
G_elements = []
G_course = []
G_nodes = []
G_edges = []

key_index = assembly.network.key_index()
keys = [key_index[key] for key in assembly.network.nodes()]

if show_current_element:
    element = assembly.element(current_key)
    artist = MeshArtist(element.mesh)
    mesh = artist.draw()
    G_element.append(mesh)

if show_course:
    course = assembly.network.node_attribute(key=current_key, name='course')
    keys_in_course = list(assembly.network.nodes_where({'course': course}))
    elements = [assembly.element(key) for key in keys_in_course]
    for element in elements:
        artist = MeshArtist(element.mesh)
        mesh = artist.draw()
        G_course.append(mesh)

if show_all and not show_until_key:
    elements = [assembly.element(key) for key in keys]
    for element in elements:
        artist = MeshArtist(element.mesh)
        mesh = artist.draw()
        G_elements.append(mesh)

if show_until_key:
    elements = [assembly.element(key) for key in keys]
    for element in elements[0:current_key+1]:
        artist = MeshArtist(element.mesh)
        mesh = artist.draw()
        G_elements.append(mesh)
        
if show_network:
    G_nodes, G_edges = NetworkArtist(assembly.network).draw()

tool_planes_WCS = [draw_frame(e.tool_frame) for e in elements]
current_tool_plane = tool_planes_WCS[current_key]
current_path_planes = [draw_frame(plane) for plane in assembly.element(current_key).path]
# ---------- end draw_3 ----------
geo = Geometry(draw_3.G_element)
geo_2 = Geometry(draw_3.G_elements)
geo_3 = Geometry(draw_3.G_course)
pln_2 = Plane(draw_3.current_tool_plane)
pln_3 = Plane(draw_3.current_path_planes)
line = Line(draw_3.G_edges)
pt_3 = Point(draw_3.G_nodes)
# Brick top plane
# Points from curves
# Surface lowest point
colour_swatch = ColourSwatch(SwatchColor=RGB(255, 122, 122))
preview_2 = CustomPreview(Geometry=line, Shader=colour_swatch)
preview_3 = CustomPreview(Geometry=geo, Shader=ColourSwatch(SwatchColor=RGB(255, 143, 143)))
preview_4 = CustomPreview(Geometry=geo_3, Shader=ColourSwatch(SwatchColor=RGB(255, 204, 0)))
preview_5 = CustomPreview(Geometry=pt_3, Shader=ColourSwatch(SwatchColor=RGB(0, 0, 0)))

preview_6 = CustomPreview(Geometry=geo_2, Shader=ColourSwatch(SwatchColor=RGB(255, 255, 255)))

# ----
# Send frame
run_4 = Button()
send_frame = GhPythonScript(planes=pln_2, ros=ros_client, run=run_4, speed=number_slider)  # inputs planes: list
# ---------- send_frame: Python ----------
from compas_rhino.conversions import RhinoPlane
from compas.geometry import Scale

import compas_rrc as rrc

abb = rrc.AbbClient(ros, '/rob1')
print('Connected.')

frames = []

scalefactor = 1000
S = Scale.from_factors([scalefactor] * 3)

if run: 
    for plane in planes :
        frame = RhinoPlane.from_geometry(plane).to_compas_frame()
        scaled_frame = frame.transformed(S)
        frames.append(scaled_frame)
    
    # Set tool
    abb.send(rrc.SetTool('t_gripper'))

    # Set work object
    abb.send(rrc.SetWorkObject('wobj0'))
    
    for frame in frames: 
        abb.send_and_wait(rrc.MoveToFrame(frame, speed, rrc.Zone.FINE, rrc.Motion.LINEAR), timeout=10)
# ---------- end send_frame ----------

current_element_key = Panel(idx)

# ----
# Pick n’ Place
safety_distance = Slider(0.05, range=0..0.1)
home_vertical = Plane(Plane(origin=(0.5500001406, -4.288937592e-07, 0.5645949341), x=(-1, 3.94200436e-06, 3.857708226e-06), y=(3.942004287e-06, 1, -1.890032101e-08)))
place_planes = Plane(draw_3.tool_planes_WCS)
pick_plane = Plane(Plane(origin=(1.075157389e-05, 0.4789661213, 0.01515229383), x=(-0.9999999998, -1.356235076e-05, -1.363541853e-05), y=(-1.35601801e-05, 0.9999999872, -0.0001591803698)))
sequence = GhPythonScript(pick_plane=pick_plane, place_planes=place_planes, home_vertical_plane=home_vertical, safety_distance=safety_distance)  # -> all_pick_sequence, all_place_sequence; inputs place_planes: list
# ---------- sequence: Python ----------
from compas_rhino.conversions import RhinoPlane
from compas.geometry import Translation, Vector
from compas_ghpython.artists import FrameArtist
from compas_ghpython.utilities import list_to_ghtree

T = Translation.from_vector(Vector.Zaxis()*safety_distance)

pick_safety_frame = RhinoPlane.from_geometry(pick_plane).to_compas_frame().transformed(T) 
pick_safety_plane = FrameArtist(pick_safety_frame).draw()

all_pick_sequence = []
all_place_sequence = []

for place_plane in place_planes:
    place_safety_frame = RhinoPlane.from_geometry(place_plane).to_compas_frame().transformed(T) 
    place_safety_plane = FrameArtist(place_safety_frame).draw()
    
    pick_sequence = list([place_safety_plane, home_vertical_plane, pick_safety_plane, pick_plane])
    place_sequence = list([pick_safety_plane, home_vertical_plane, place_safety_plane, place_plane])
    
    all_pick_sequence.append(pick_sequence)
    all_place_sequence.append(place_sequence)

all_pick_sequence = list_to_ghtree(all_pick_sequence)
all_place_sequence = list_to_ghtree(all_place_sequence)
# ---------- end sequence ----------
run_5 = Button()
send = GhPythonScript(
    run=run_5,
    send_elements=list_3,
    current_key=current_element_key,
    all_pick_sequence=sequence.all_pick_sequence,
    all_place_sequence=sequence.all_place_sequence,
    ros=ros_client,
    speed=number_slider,
    collision_mesh=table_mesh)  # inputs current_key: Int32, all_pick_sequence: tree of Plane, all_place_sequence: tree of Plane, collision_mesh: Mesh
# ---------- send: Python ----------
from compas_rhino.conversions import RhinoPlane, RhinoMesh
from compas.geometry import Scale, Frame
from compas_fab.robots import Robot
from compas_ghpython.utilities import ghtree_to_list
import compas_rrc as rrc
import time


all_pick_sequence = ghtree_to_list(all_pick_sequence)[0]
all_place_sequence = ghtree_to_list(all_place_sequence)[0]

if send_elements == "current":
    all_pick_sequence = list([all_pick_sequence[current_key]])
    all_place_sequence = list([all_place_sequence[current_key]])

abb = rrc.AbbClient(ros, '/rob1')
print('Connected.')

scalefactor = 1000
S = Scale.from_factors([scalefactor] * 3)

if run:
    # Set tool
    abb.send(rrc.SetTool('t_gripper'))
    # Set work object
    abb.send(rrc.SetWorkObject('wobj0'))
    print("in_run")
    
    for i in range(len(all_place_sequence)):
        
        frames_place = []
        frames_pick = []
        
        #close gripper
        abb.send_and_wait(rrc.SetDigital('ABB_Scalable_IO_0_DO16', 0), timeout=5)
        abb.send_and_wait(rrc.WaitTime(1))
        
        #send the place sequence
        for plane_place in all_place_sequence[i]:
            frame_place = RhinoPlane.from_geometry(plane_place).to_compas_frame()
            scaled_frame_place = frame_place.transformed(S)
            print scaled_frame_place
            abb.send_and_wait(rrc.MoveToFrame(scaled_frame_place, speed, rrc.Zone.FINE, rrc.Motion.LINEAR), timeout=10)
        
        #open gripper
        abb.send_and_wait(rrc.SetDigital('ABB_Scalable_IO_0_DO16', 1), timeout=5)
        
        #send the pick sequence
        for plane_pick in all_pick_sequence[i]:
            frame_pick = RhinoPlane.from_geometry(plane_pick).to_compas_frame()
            scaled_frame_pick = frame_pick.transformed(S)
            abb.send_and_wait(rrc.MoveToFrame(scaled_frame_pick, speed, rrc.Zone.FINE, rrc.Motion.LINEAR), timeout=10)
# ---------- end send ----------

# ==== cluster Cluster
rec = ClusterInput()
rec_2 = ClusterInput()
rec_3 = DataRecorder(rec, DataLimit=-10, RecordData=True)
rec_4 = DataRecorder(simplify(flatten(rec_2)), DataLimit=-10, RecordData=True)
clean = CleanTree(RemoveNulls=True, RemoveInvalid=True, RemoveEmpty=False, Tree=flatten(rec_4))
clean_2 = CleanTree(RemoveNulls=True, RemoveInvalid=True, RemoveEmpty=False, Tree=rec_3)
item = ListItem(List=clean, Index="-1", Wrap=True)
item_2 = ListItem(List=clean_2, Index="-1", Wrap=True)
configuration = Data(item)
draw = Draw(cg=item_2)  # -> rg
#   port cg: The COMPAS geometry or datastructure to be drawn.
#   port rg: The Rhino geometry object.
# ---------- draw: Python ----------
"""
Draws COMPAS geometry in Grasshopper.
"""
from ghpythonlib.componentbase import executingcomponent as component

from compas.artists import Artist


class CompasToRhinoGeometry(component):
    def RunScript(self, cg):
        if not cg:
            return None

        return Artist(cg).draw()
# ---------- end draw ----------
python = GhPythonScript(frame=item_2)  # -> out, plane
# ---------- python: Python ----------
import compas_rhino.conversions
import compas.artists
import compas_ghpython as cp

plane = cp.draw_frame(frame)
# ---------- end python ----------
configuration_2 = ClusterOutput(configuration)
plane = ClusterOutput(draw)
